# Grasshopper definition sample_karamba_definition.ghx

crv = Curve()
diameter = Slider(8.5, range=2..20)
crosec = CircularHollowProfile(Diameter=diameter)
ltob = LineToBeam(Line=crv, CroSec=crosec)
supp = Support()
grav = Gravity()
assemble = AssembleModel(Elem=ltob, Support=supp, Load=grav)
analyze = Analyze(Model=assemble)  # -> Model, Disp
gala = Galapagos()
bview = BeamView(Model=analyze.Model)
